# Dynamo graph Determine Panel dimensions Rev.00 - withOutElement ID-newest.dyn (Dynamo 3.3.0.6316)
# packages: DynamoUnfold 1.0.1

# group: Select Curtain Panels
select_model_elements = DSModelElementsSelection()  # 2 picked in the model; graph input
watch = Watch(select_model_elements)
flatten = List.Flatten(list=watch)
string_from_object = FromObject()  # unwired: object
code_block = CodeBlock(a=watch) { a[1]; }
string_from_object_2 = FromObject(object=code_block)
boolean = BoolSelector(false)  # graph input
contains = String.Contains(searchFor=string_from_object_2, ignoreCase=boolean)  # unwired: string
compose = ComposeFunctions(function0=string_from_object, function1=contains)  # "Function.Compose"
filter = List.Filter(list=flatten, condition=compose)
match = Watch(filter.in)

faces = Element.Faces(element=match)

# group: Maximum area
area = Surface.Area(surface=faces)
maximumItem = List.MaximumItem()  # unwired: list
map = List.Map(list=area, function=maximumItem)
indexOf = List.IndexOf(list=area, element=map, lacing=Shortest)

# group: Unfold
getItemAtIndex = List.GetItemAtIndex(list=faces, index=indexOf, lacing=Shortest)
coordinateSystemAtParameter = Surface.CoordinateSystemAtParameter(surface=getItemAtIndex)
identity = CoordinateSystem.Identity()
# note: DynamoUnfold
transform = Geometry.Transform(geometry=getItemAtIndex, fromCoordinateSystem=coordinateSystemAtParameter, contextCoordinateSystem=identity)
XAxis = Vector.XAxis()
count = List.Count(list=transform)
distance_between_each_panels = DoubleSlider(20, range=0..2500 step 0.1)  # graph input
code_block_2 = CodeBlock(itemsTobeTranslate=count, Distance=distance_between_each_panels) { 50..#itemsTobeTranslate..Distance; }
translate = Geometry.Translate(geometry=transform, direction=XAxis, distance=code_block_2)
unfoldListOfSurfaces_AndReturnTransforms = DynamoUnfold.Unfolding.UnfoldListOfSurfaces_AndReturnTransforms(surfaces=translate)
labels_size = CodeBlock { 0.5; }
generateUnfoldedLabels = DynamoUnfold.Unfolding.GenerateUnfoldedLabels(unfoldingObject=unfoldListOfSurfaces_AndReturnTransforms.unfoldingObject, labelScale=labels_size)
flatten_2 = List.Flatten(list=generateUnfoldedLabels)
unfoldListOfSurfaces_AndReturnTransforms_2 = DynamoUnfold.Unfolding.UnfoldListOfSurfaces_AndReturnTransforms(surfaces=getItemAtIndex)
generateInitialLabels = DynamoUnfold.Unfolding.GenerateInitialLabels(unfoldingObject=unfoldListOfSurfaces_AndReturnTransforms_2.unfoldingObject, labelScale=labels_size)
flatten_3 = List.Flatten(list=generateInitialLabels)

perimeterCurves = Surface.PerimeterCurves(surface=unfoldListOfSurfaces_AndReturnTransforms.surfaces)

# group: ModelCurve To Revit
byCurve = ModelCurve.ByCurve(curve=perimeterCurves)

code_block_3 = CodeBlock { 0; }
count_2 = List.Count(list=getItemAtIndex)
code_block_4 = CodeBlock { 1; }
sub = count_2 - code_block_4
range = Range(start=code_block_3, end=sub, step=code_block_4)

# group: 3D Annotation on Base Surface > 3D Annotation on Unfolded Surface
code_block_5 = CodeBlock()
# ---------- code_block_5.designscript (2 lines) ----------
["3DName","On Plan view",
"On Elevation","TextSize","Depth"];
# ----------------------------------------
setParameterByName = Element.SetParameterByName(parameterName=code_block_5)  # unwired: element, value
family_types = FamilyTypes("3DName:3DName")  # graph input
code_block_6 = CodeBlock { 0.5; }
pointAtParameter = Surface.PointAtParameter(surface=translate, u=code_block_6, v=code_block_6)  # frozen
byPoint = FamilyInstance.ByPoint(familyType=family_types, point=pointAtParameter)
string_from_object_3 = FromObject(object=range)
code_block_7 = CodeBlock { 1; 0; 0.1; 0.1; }
count_3 = List.Count(list=byPoint)
ofRepeatedItem = List.OfRepeatedItem(item=code_block_7.out0, amount=count_3)
ofRepeatedItem_2 = List.OfRepeatedItem(item=code_block_7.out1, amount=count_3)
ofRepeatedItem_3 = List.OfRepeatedItem(item=code_block_7.out2, amount=count_3)

ofRepeatedItem_4 = List.OfRepeatedItem(item=code_block_7.out3, amount=count_3)

# group (continued): 3D Annotation on Base Surface > 3D Annotation on Unfolded Surface
code_block_8 = CodeBlock(a=string_from_object_3, b=ofRepeatedItem, c=ofRepeatedItem_2, d=ofRepeatedItem_3, e=ofRepeatedItem_4) { [a,b,c,d,e]; }
transpose = List.Transpose(lists=code_block_8)
combine = List.Combine(combineFunction=setParameterByName, list0=byPoint, list1=transpose)

flatten_4 = List.Flatten(list=combine)

# group: 3D Annotation on Base Surface
code_block_9 = CodeBlock { ["3DName","TextSize","Depth"]; }
setParameterByName_2 = Element.SetParameterByName(parameterName=code_block_9)  # unwired: element, value
family_types_2 = FamilyTypes("3DName Facebased:3DName Facebased")  # graph input
code_block_10 = CodeBlock { 0.5; }
pointAtParameter_2 = Surface.PointAtParameter(surface=getItemAtIndex, u=code_block_10, v=code_block_10)
string_from_object_4 = FromObject(object=range)
code_block_11 = CodeBlock { 0.1; 0.1; }

normalAtParameter = Surface.NormalAtParameter(surface=getItemAtIndex, u=code_block_10, v=code_block_10)
coordinateSystemAtParameter_2 = Surface.CoordinateSystemAtParameter(surface=getItemAtIndex, u=code_block_10, v=code_block_10)
XAxis_2 = CoordinateSystem.XAxis(coordinateSystem=coordinateSystemAtParameter_2)
code_block_12 = CodeBlock { 90; }
rotate = Vector.Rotate(vector=normalAtParameter, axis=XAxis_2, degrees=code_block_12)

# group (continued): 3D Annotation on Base Surface
byFace = FamilyInstance.ByFace(familyType=family_types_2, face=getItemAtIndex, location=pointAtParameter_2, referenceDirection=rotate)
count_4 = List.Count(list=byFace)
ofRepeatedItem_5 = List.OfRepeatedItem(item=code_block_11.out0, amount=count_4)
ofRepeatedItem_6 = List.OfRepeatedItem(item=code_block_11.out1, amount=count_4)
code_block_13 = CodeBlock(a=string_from_object_4, b=ofRepeatedItem_5, c=ofRepeatedItem_6) { [a,b,c]; }
transpose_2 = List.Transpose(lists=code_block_13)
combine_2 = List.Combine(combineFunction=setParameterByName_2, list0=byFace, list1=transpose_2)
flatten_5 = List.Flatten(list=combine_2)
code_block_14 = CodeBlock(num=flatten_5)
# ---------- code_block_14.designscript (11 lines) ----------
r=Color.ByARGB(255,255,0,0);
o=Color.ByARGB(255,255,128,0);
y=Color.ByARGB(255,255,255,0);
g=Color.ByARGB(255,0,255,0);
b=Color.ByARGB(255,0,128,255);
i=Color.ByARGB(255,0,0,255);
v=Color.ByARGB(255,127,0,255);
colors=[r,o,y,g,b,i,v];
0..1..#7;
a=List.Count(num);
0..1..#a;
# ----------------------------------------
color_range = ColorRange(colors=code_block_14.colors, indices=code_block_14.out8, value=code_block_14.out10)

# group: 3D Annotation
overrideColorInView = Element.OverrideColorInView(element=flatten_4, color=color_range)

# group: Labels on Unflod Surface
byCurve_2 = ModelCurve.ByCurve(curve=flatten_2)

# group: Labels on Base Surface
byCurve_3 = ModelCurve.ByCurve()  # unwired: curve

perimeterCurves_2 = Surface.PerimeterCurves(surface=unfoldListOfSurfaces_AndReturnTransforms.surfaces)
byJoinedCurves = PolyCurve.ByJoinedCurves(curves=perimeterCurves_2)
code_block_15 = CodeBlock { 0.02; }
offsetMany = Curve.OffsetMany(curve=byJoinedCurves, signedDistance=code_block_15)
explode = Geometry.Explode(geometry=offsetMany)
byJoinedCurves_2 = PolyCurve.ByJoinedCurves(curves=explode)

# group: Curves to ModelLine
curves = PolyCurve.Curves(polyCurve=byJoinedCurves_2)
byCurve_4 = ModelCurve.ByCurve(curve=curves)

byJoinedCurves_3 = PolyCurve.ByJoinedCurves(curves=curves)
curves_2 = PolyCurve.Curves(polyCurve=byJoinedCurves_3)

# group: Length
length = Curve.Length(curve=curves_2)
watch_2 = Watch(length)
code_block_16 = CodeBlock { 2; }
flatten_6 = List.Flatten(list=watch_2, amount=code_block_16)

# group: Items
count_5 = List.Count()  # unwired: list
map_2 = List.Map(list=watch_2, function=count_5)
ofRepeatedItem_7 = List.OfRepeatedItem(item=range, amount=map_2, lacing=Longest)
flatten_7 = List.Flatten(list=ofRepeatedItem_7)
watch_3 = Watch(flatten_7)

# group: Description
string_from_object_5 = FromObject()  # unwired: object
count_6 = List.Count()  # unwired: list
map_3 = List.Map(list=watch_2, function=count_6)
ofRepeatedItem_8 = List.OfRepeatedItem(item=string_from_object_5, amount=map_3, lacing=Longest)
code_block_17 = CodeBlock { 2; }
flatten_8 = List.Flatten(list=ofRepeatedItem_8, amount=code_block_17)

length_2 = Curve.Length(curve=byJoinedCurves_3)

# group: Location
watch_4 = Watch()  # unwired: arg0
string_from_object_6 = FromObject(object=watch_4)
code_block_18 = CodeBlock { 0; 6; }
remove = String.Remove(string=string_from_object_6, startIndex=code_block_18.out0, count=code_block_18.out1)
string_from_object_7 = FromObject(object=remove)
length_3 = String.Length(string=string_from_object_7)
code_block_19 = CodeBlock(x=length_3) { x-1; }
substring = String.Substring(string=remove, startIndex=code_block_18.out0, length=code_block_19)
flatten_9 = List.Flatten(list=substring)
watch_5 = Watch(flatten_9)

getItemAtIndex_2 = List.GetItemAtIndex(list=match, index=range)

# group: Mark
count_7 = List.Count()  # unwired: list
map_4 = List.Map(list=watch_2, function=count_7)
ofRepeatedItem_9 = List.OfRepeatedItem(item=getItemAtIndex_2, amount=map_4, lacing=Longest)
flatten_10 = List.Flatten(list=ofRepeatedItem_9)
code_block_20 = CodeBlock { ["Mark"]; }
getParameterValueByName = Element.GetParameterValueByName(element=flatten_10, parameterName=code_block_20, lacing=CrossProduct)
flatten_11 = List.Flatten(list=getParameterValueByName)

# group: Total Length
code_block_21 = CodeBlock { ""; }
code_block_22 = CodeBlock(x=map_4) { x-1; }
ofRepeatedItem_10 = List.OfRepeatedItem(item=code_block_21, amount=code_block_22, lacing=Longest)
code_block_23 = CodeBlock { 1; }
flatten_12 = List.Flatten(list=ofRepeatedItem_10, amount=code_block_23)
addItemToEnd = List.AddItemToEnd(item=length_2, list=flatten_12, lacing=Longest)
flatten_13 = List.Flatten(list=addItemToEnd)

# group: Surface.Area
area_2 = Surface.Area(surface=getItemAtIndex)
code_block_24 = CodeBlock(x=area_2) { x/1000000; }
code_block_25 = CodeBlock { ""; }
code_block_26 = CodeBlock(x=map_4) { x-1; }
ofRepeatedItem_11 = List.OfRepeatedItem(item=code_block_25, amount=code_block_26, lacing=Longest)
code_block_27 = CodeBlock { 1; }
flatten_14 = List.Flatten(list=ofRepeatedItem_11, amount=code_block_27)
addItemToEnd_2 = List.AddItemToEnd(item=code_block_24, list=flatten_14, lacing=Longest)
flatten_15 = List.Flatten(list=addItemToEnd_2)

code_block_28 = CodeBlock { true; }

# group: To Excel
string = StringInput("J:\namaa\1.revit\REMATGIT\Curtain_Schedule.xlsx")  # graph input
code_block_29 = CodeBlock { "Sheet1"; 1; 0; }
create = List.Create(item0=watch_3, item1=flatten_8, item2=flatten_6, item3=flatten_13, item4=flatten_15, item5=watch_5, item6=flatten_11)
transpose_3 = List.Transpose(lists=create)
exportToExcel = Data.ExportToExcel(sheetName=code_block_29.out0, startRow=code_block_29.out1, startColumn=code_block_29.out2, data=transpose_3, overWrite=code_block_28, writeAsString=code_block_28)  # unwired: filePath

code_block_30 = CodeBlock { 1; }
range_2 = Range(start=code_block_30, end=count_2, step=code_block_4)

# group: 3D Annotation
overrideColorInView_2 = Element.OverrideColorInView(element=flatten_5, color=color_range)

geometry = Element.Geometry(element=overrideColorInView_2)
contextCoordinateSystem = Geometry.ContextCoordinateSystem(geometry=geometry)
transform_2 = Geometry.Transform(geometry=geometry, fromCoordinateSystem=contextCoordinateSystem, contextCoordinateSystem=identity)
categories = Categories()  # nothing selected
view = Viewport.View()  # unwired: viewport
offsetMany_2 = Curve.OffsetMany(curve=curves_2)
byElements = Dimension.ByElements(view=view, line=offsetMany_2)  # unwired: referenceElements
view_family_types = ViewFamilyTypes("Floor Plan")
